# Grasshopper definition JESS.gh (Grasshopper 1.0.7)
# plug-ins: GH_CPython, FalseStartToggle, Human

panel = Panel("C:\\Users\\amd\\AppData\\Local\\Programs\\Python\\Python38\\python.exe")
# Users API: https://api.ensims.com/users/api
panel_2 = Panel("C:\\Users\\amd\\Documents\\GitHub\\JESS-Grasshopper\\JESS_CLI.py")
# BASE
# JESS API: https://api.ensims.com/jess_web/api
false_start_toggle = FalseStartToggle(False)
# JESS
eto_form = GhPythonScript(Python3=panel, JESS_CLI=panel_2, run=false_start_toggle)  # -> cookie
# ---------- eto_form: Python ----------
"""This component requests cookie from the JESS
    Inputs:
        Python3: The filepath to the 3.X python interpreter
        JESS_CLI: The filepath to the JESS CLI
        run: Set to True to run the component
    Output:
        cookie: Cookie value
"""
#This script is based on source code https://developer.rhino3d.com/guides/rhinopython/eto-forms-python/#the-layout

import Rhino
import scriptcontext
import System
import Rhino.UI
import Eto.Drawing as drawing
import Eto.Forms as forms

# Eto dialog class
class EtoDialogClass(forms.Dialog[bool]):

    # Dialog box Class initializer
    def __init__(self):
        # Initialize dialog box
        self.Title = 'ENSIMS/JESS login'
        self.Padding = drawing.Padding(10)
        self.Resizable = False

        # Create controls for the dialog
        self.m_label = forms.Label(Text = 'User email:')
        self.m_textbox = forms.TextBox(Text = None)
        self.p_label = forms.Label(Text = 'Password:')
        self.p_textbox = forms.PasswordBox()

        # Create the default button
        self.DefaultButton = forms.Button(Text = 'OK')
        self.DefaultButton.Click += self.OnOKButtonClick

        # Create the abort button
        self.AbortButton = forms.Button(Text = 'Cancel')
        self.AbortButton.Click += self.OnCloseButtonClick

        # Create a table layout and add all the controls
        layout = forms.DynamicLayout()
        layout.Spacing = drawing.Size(5, 5)
        layout.AddRow(self.m_label, self.m_textbox)
        layout.AddRow(self.p_label, self.p_textbox)
        layout.AddRow(None) # spacer
        layout.AddRow(self.DefaultButton, self.AbortButton)

        # Set the dialog content
        self.Content = layout

    # Start of the class functions
    global data
    # Get the value of the textbox
    def GetText(self):
        data = {"user_email":self.m_textbox.Text, "password":self.p_textbox.Text}
        return data

    def GetLogin(self):
        return self.m_textbox.Text

    def GetPassword(self):
        return self.p_textbox.Text

    # Close button click handler
    def OnCloseButtonClick(self, sender, e):
        self.m_textbox.Text = ""
        self.Close(False)

    # OK button click handler
    def OnOKButtonClick(self, sender, e):
        if self.m_textbox.Text == "":
            self.Close(False)
        else:
            self.Close(True)

    ## End of Dialog Class ##

# The script that will be using the dialog.
def LoginDialog():
    dialog = EtoDialogClass();
    rc = dialog.ShowModal(Rhino.UI.RhinoEtoApp.MainWindow)
    if (rc):
        dialog.GetText() #Print the Room Number from the dialog control
        user_email = dialog.GetLogin()
        password = dialog.GetPassword()
    
    import subprocess
    commands = [Python3, JESS_CLI, "cookie", user_email, password]
    cookie = subprocess.check_output(commands,
                                     stderr=subprocess.STDOUT,
                                     shell=True)
    return cookie.strip()

##########################################################################
# Check to see if this file is being executed as the "main" python
# script instead of being used as a module by some other python script
# This allows us to use the module which ever way we want.
if __name__ == "__main__":
    if run == True:
        cookie = LoginDialog()
        import scriptcontext as sc
        sc.sticky["cookie"] = cookie
        sc.sticky["Python3"] = Python3
        sc.sticky["JESS_CLI"] = JESS_CLI
        print(len(cookie.strip()))
# ---------- end eto_form ----------
# {
#     "command": "Create",
#     "projectID": "circle-py",
#     "problem": {
#         "name": "circle",
#         "description": "Test constrained mo fucntion with two variables",
#         "variables": [
#             {
#                 "name": "x",
#                 "caption": "x in [0, 1]",
#                 "valueStr": "[0:0.01:1]",
#                 "maskStr": "[0:0.1:1]",
#                 "valueType": "Number"
#             },
#             {
#                 "name": "y",
#                 "caption": "y in [0, 1]",
#                 "valueStr": "[0:0.01:1]",
#                 "maskStr": "[0:0.1:1]",
#                 "valueType": "Number"
#             }
#         ],
#         "evalResults": [
#             {
#                 "name": "f1",
#                 "caption": "Evaluation f1 = 100 * x",
#                 "unit": "-"
#             },
#             {
#                 "name": "f2",
#                 "caption": "Evaluation f2 = 100 * y",
#                 "unit": "-"
#             }
#         ],
#         "userMetrics": [],
#         "objectives": [
#             {
#                 "name": "t1",
#                 "caption": "Objective t1 = f1",
#                 "unit": "-",
#                 "direction": "Minimize",
#                 "formula": "f1"
#             },
#             {
#                 "name": "t2",
#                 "caption": "Objective t2 = f2",
#                 "unit": "-",
#                 "direction": "Minimize",
#                 "formula": "f2"
#             }
#         ],
#         "constraints": [
#             {
#                 "name": "s1",
#                 "caption": "Constraint s1 <= 30",
#                 "unit": "-",
#                 "formula": "Math.sqrt(Math.pow(f1-50, 2) + Math.pow(f2-50, 2))",
#                 "lb": 0,
#                 "ub": 30,
#                 "min": 0,
#                 "max": 100,
#                 "weight": 1
#             }
#         ]
#     },
#     "config": {
#         "algorithm": "Parametrics",
#         "sampleSize": 0,
#         "initSampleOption": "RANDOM",
#         "initPopSize": 10,
#         "evolvePopSize": 10,
#         "maxPopSize": 10000,
#         "mutationRate": 0.2,
#         "crossoverRate": 1,
#         "tournamentSize": 2,
#         "objectiveBias": 0,
#         "elitismTolerance": 0,
#         "maxGenerations": 100,
#         "maxEvaluations": 1000,
#         "maxComputingTime": 100,
#         "maxWallTime": 24
#     },
#     "smdata": {
#         "modelID": "circle",
#         "model": "",
#         "type": "Python3"
#     }
# }
ghpython_script = GhPythonScript()  # -> cookie
# ---------- ghpython_script: Python ----------
__author__ = "BT"
__version__ = "2020.09.29"

import scriptcontext as rs

cookie = rs.sticky["cookie"] #output the value of the sticky
# ---------- end ghpython_script ----------
# URL
# GET: #Users API info
# https://api.ensims.com/users/api/info
# # retrieve a file in a particular folder
# r = requests.get(UserApi + 'files/' + file, cookies=r.cookies)
# # View folder contents
# r = requests.get(UserApi + 'files/' + folder, cookies=r.cookies)
# POST: #Check-in
# r = requests.post(UserApi + 'checkin', cookies=r.cookies)
# # POST files to JESS
# files = {'file': open(file, 'rb')}
# r = requests.post(UserApi + 'files/' + folder, files=files, cookies=r.cookies)
# DELETE: # Delete the folder
# r = requests.delete(UserApi + 'files/' + folder, cookies=r.cookies)
# POST: # Post job on jess client and get job ID
# r = requests.post(JessApi + 'job', files=files, cookies=r.cookies)
# GET: # GET specific text with job_id and filename
# r = requests.get(JessApi + 'job/file/' + job_id + '/' + filename, cookies=r.cookies)
# # GET job status with job_id
# r = requests.get(JessApi + 'job/dir/' + job_id, cookies=r.cookies)
# # Download all job output in as a zip file
# r = requests.get(JessApi + 'job/file/' + job_id, cookies=r.cookies)
# # Get job status by ID
# r = requests.get(JessApi + 'job/status/' + job_id, cookies=r.cookies)
# # GET job output file list by job_id
# r = requests.get(JessApi + 'job/dir/' + job_id, cookies=r.cookies)
panel_3 = Panel("https://api.ensims.com/users/api/files/test/0/Shoebox_v8.9/cntr_Heathrow_TRY.epw")
# https://api.ensims.com/jess_web/api/info
panel_4 = Panel("https://api.ensims.com/users/api/info")
create_jea_project = CreateJEAProject(cookie=ghpython_script)  # -> output, project_id; inputs cookie: list
# ---------- create_jea_project: Python ----------
# -*- coding: utf-8 -*-
""" 
Python Script
Created on  Tuesday September 2020 08:46:17 
@author:  BT 

[desc]
Description of the plugin Here
Write here any thing... 
[/desc]

ARGUMENTS:
----------
<inp> 
    cookie :[required] - [type = string] - [default = None] 
    Descripe your input here 
        * bullet point.
        * bullet point
</inp>
<inp> 
    json :[required] - [type = string] - [default = None] 
    Descripe your input here 
        * bullet point.
        * bullet point
</inp>

RETURN:
----------
    <out>
        output : indicate your output description here. \n refers to a new line.
    </out>

"""
import requests, pickle

# API endpoint URL
ApiBase = 'https://api.ensims.com/'
JeaApi = ApiBase + "jea_web/api/"

#Load cookie
r = requests.get(JeaApi + 'info')
with open(cookie, 'rb') as f:
    r.cookies.update(pickle.load(f))

json = {
    "command": "Create",
    "projectID": "circle-py",
    "problem": {
        "name": "circle",
        "description": "Test constrained mo fucntion with two variables",
        "variables": [
            {
                "name": "x",
                "caption": "x in [0, 1]",
                "valueStr": "[0:0.01:1]",
                "maskStr": "[0:0.1:1]",
                "valueType": "Number"
            },
            {
                "name": "y",
                "caption": "y in [0, 1]",
                "valueStr": "[0:0.01:1]",
                "maskStr": "[0:0.1:1]",
                "valueType": "Number"
            }
        ],
        "evalResults": [
            {
                "name": "f1",
                "caption": "Evaluation f1 = 100 * x",
                "unit": "-"
            },
            {
                "name": "f2",
                "caption": "Evaluation f2 = 100 * y",
                "unit": "-"
            }
        ],
        "userMetrics": [],
        "objectives": [
            {
                "name": "t1",
                "caption": "Objective t1 = f1",
                "unit": "-",
                "direction": "Minimize",
                "formula": "f1"
            },
            {
                "name": "t2",
                "caption": "Objective t2 = f2",
                "unit": "-",
                "direction": "Minimize",
                "formula": "f2"
            }
        ],
        "constraints": [
            {
                "name": "s1",
                "caption": "Constraint s1 <= 30",
                "unit": "-",
                "formula": "Math.sqrt(Math.pow(f1-50, 2) + Math.pow(f2-50, 2))",
                "lb": 0,
                "ub": 30,
                "min": 0,
                "max": 100,
                "weight": 1
            }
        ]
    },
    "config": {
        "algorithm": "Parametrics",
        "sampleSize": 0,
        "initSampleOption": "RANDOM",
        "initPopSize": 10,
        "evolvePopSize": 10,
        "maxPopSize": 10000,
        "mutationRate": 0.2,
        "crossoverRate": 1,
        "tournamentSize": 2,
        "objectiveBias": 0,
        "elitismTolerance": 0,
        "maxGenerations": 100,
        "maxEvaluations": 1000,
        "maxComputingTime": 100,
        "maxWallTime": 24
    },
    "smdata": {
        "modelID": "circle",
        "model": "",
        "type": "Python3"
    }
}

project_id = json['projectID']

# Send command
r = requests.post(JeaApi + 'command', json=json, cookies=r.cookies)

# Show response
output = r.json()
# ---------- end create_jea_project ----------
panel_5 = Panel(create_jea_project.output)
get_jea_status = GetJEAStatus(cookie=ghpython_script, project_id=create_jea_project.project_id)  # -> output; inputs cookie: list, project_id: list
# ---------- get_jea_status: Python ----------
# -*- coding: utf-8 -*-
""" 
Python Script
Created on  Tuesday September 2020 08:46:17 
@author:  BT 

[desc]
Description of the plugin Here
Write here any thing... 
[/desc]

ARGUMENTS:
----------
<inp> 
    _input :[required] - [type = int] - [default = None] 
    Descripe your input here 
        * bullet point.
        * bullet point
</inp>
<inp>
    Other inputs go here ...
</inp>

RETURN:
----------
    <out>
        output_ : indicate your output description here. \n refers to a new line.
    </out>

"""
import requests, pickle

# API endpoint URL
ApiBase = 'https://api.ensims.com/'
JeaApi = ApiBase + "jea_web/api/"

#Load cookie
r = requests.get(JeaApi + 'info')
with open(cookie, 'rb') as f:
    r.cookies.update(pickle.load(f))

# Get the status of the project
r = requests.get(JeaApi + 'start/' + project_id, cookies=r.cookies)

# Show response
output = r.json()
# ---------- end get_jea_status ----------
post = GhPythonScript(url="https://api.ensims.com/users/api/checkin")  # -> output, data, job_id
# ---------- post: Python ----------
"""Requests POST method
    Inputs:
        url: The url that contains both base and url
        file: The filepath for the file
    Output:
        data: Requsts response
"""

__author__ = "amd"
__version__ = "2020.11.14"

import scriptcontext as sc
import subprocess, json

Python3 = sc.sticky['Python3']
JESS_CLI = sc.sticky['JESS_CLI']
cookie = sc.sticky['cookie']

if file == None:
    args = ['post', cookie, url]
else:
    args = ['postf', cookie, url, file]
    
comm = subprocess.Popen([Python3, JESS_CLI] + args, stdout = subprocess.PIPE)
data, error = comm.communicate()
print(data)
comm.stdout.close()
comm.wait()

if "data" in json.loads(data):
    job_id = json.loads(data)["data"]
# ---------- end post ----------
get = GhPythonScript(url=panel_4)  # -> output, data
# ---------- get: Python ----------
"""Requests GET method
    Inputs:
        url: The url that contains both base and url
    Output:
        data: Requsts response
"""
__author__ = "amd"
__version__ = "2020.11.14"

import scriptcontext as sc
import subprocess
Python3 = sc.sticky['Python3']
JESS_CLI = sc.sticky['JESS_CLI']
cookie = sc.sticky['cookie']

args = ['get', cookie, url]
comm = subprocess.Popen([Python3, JESS_CLI] + args, stdout = subprocess.PIPE)
data, error = comm.communicate()
print(data)
comm.stdout.close()
# ---------- end get ----------
delete = GhPythonScript(url=panel_3)  # -> output, data
# ---------- delete: Python ----------
"""Requests DELETE method
    Inputs:
        url: The url that contains base, url and (file or folder) path
    Output:
        data: Requsts response
"""

__author__ = "amd"
__version__ = "2020.11.14"

import scriptcontext as sc
import subprocess
Python3 = sc.sticky['Python3']
JESS_CLI = sc.sticky['JESS_CLI']
cookie = sc.sticky['cookie']

args = ['delete', cookie, url]
comm = subprocess.Popen([Python3, JESS_CLI] + args, stdout = subprocess.PIPE)
data, error = comm.communicate()
print(data)
comm.stdout.close()
comm.wait()
# ---------- end delete ----------
panel_6 = Panel(get_jea_status)
panel_7 = Panel("""job/file
job/dir
job/file
job/status""")
# TODO
# 1. Async component for checking job status
panel_8 = Panel(post.data)
panel_9 = Panel(get.data)
panel_10 = Panel(delete.data)
item_selector = ItemSelector(panel_7, {"job/file", "job/dir", "job/file", "job/status"}, selected="job/file")
# JESS API: https://api.ensims.com/jess_web/api/
users_api = Panel("https://api.ensims.com/users/api/")
panel_11 = Panel("{'file': open('C:/Users/amd/Documents/GitHub/JESS-Grasshopper/job_example/Shoebox_v8.9.zip', 'rb')}")
panel_12 = Panel("{('file', ('5ZoneAirCooled-v93.idf', open('job_example\\5ZoneAirCooled-v93.idf', 'rb'), 'text/plain')),('file', ('in.epw', open('job_example\\in.epw', 'rb'), 'text/plain')),('title', 'Test job'),('desc', 'Grasshopper Test'),('model', '5ZoneAirCooled-v93.idf'),('split', 'FALSE'),('weather', 'in.epw')}")
# Users API: https://api.ensims.com/users/api/
jess_api = Panel("https://api.ensims.com/jess_web/api/")
folder = Panel("test/0")
format = Format(Format="{0}{1}{2}", Culture=127, Data0=users_api, Data1="files/", Data2=folder)
# https://developer.rhino3d.com/guides/grasshopper/
# https://www.grasshopper3d.com/forum/topics/changing-the-description-of-and-input-output-in-python
# www.speckle.systems
url = Panel(format)
post_2 = GhPythonScript(url=format, file=panel_11)  # -> output, data, job_id; same code as post
get_2 = GhPythonScript(url=format)  # -> output, data; same code as get
format_2 = Format(Format="{0}{1}{2}", Culture=127, Data0=jess_api, Data1="job")
panel_13 = Panel(get_2.data)
panel_14 = Panel(post_2.data)
post_job = Panel(format_2)
post_3 = GhPythonScript(url=format_2, files=panel_12)  # -> output, data, job_id
# ---------- post_3: Python ----------
"""Requests POST method
    Inputs:
        url: The url that contains both base and url
        file: The filepath for the file
    Output:
        data: Requsts response
"""

__author__ = "amd"
__version__ = "2020.11.14"

import scriptcontext as sc
import subprocess, json

Python3 = sc.sticky['Python3']
JESS_CLI = sc.sticky['JESS_CLI']
cookie = sc.sticky['cookie']

if file == None:
    args = ['post', cookie, url]
else:
    args = ['postf', cookie, url, files]
    
comm = subprocess.Popen([Python3, JESS_CLI] + args, stdout = subprocess.PIPE)
data, error = comm.communicate()
print(data)
comm.stdout.close()
comm.wait()

if "data" in json.loads(data):
    job_id = json.loads(data)["data"]
# ---------- end post_3 ----------
panel_15 = Panel(post_3.data)
panel_16 = Panel(post_3.job_id)
